# Dynamo graph Building Generator.dyn (Dynamo 2.0.2.6826)

XY = Plane.XY()
string = StringInput("U")
length = DoubleSlider(30000, range=0..100000 step 1000)
width = DoubleSlider(25000, range=0..100000 step 1000)
depth = DoubleSlider(8000, range=0..30000 step 1000)
total_floor_area = DoubleSlider(400000, range=0..10000000 step 1000)
floor_height = DoubleSlider(11000, range=0..40000 step 1000)
boolean = BoolSelector(false)
buildingGenerator = Buildings.Creation.BuildingGenerator(BasePlane=XY, Type=string, Length=length, Width=width, Depth=depth, BldgArea=total_floor_area, FloorHeight=floor_height, CreateCore=boolean)
angle_threshold = DoubleSlider(45, range=0..180 step 1)
deceonstructFacadeShell = Buildings.Analysis.DeceonstructFacadeShell(Mass=buildingGenerator.Floors, AngleThreshold=angle_threshold)
byJoinedSurfaces = PolySurface.ByJoinedSurfaces(surfaces=deceonstructFacadeShell.HorizontalSurfaces)
byJoinedSurfaces_2 = PolySurface.ByJoinedSurfaces(surfaces=deceonstructFacadeShell.VerticalSurfaces)
bySolid = PolySurface.BySolid(solid=buildingGenerator.Floors)
siteContext = Site.Analysis.SiteContext(RevitSite=bySolid)
toCuboid = BoundingBox.ToCuboid(boundingBox=siteContext.BoundingBoxes)
watch = Watch(siteContext.Heights)
code_block = CodeBlock()
# ---------- code_block.designscript (6 lines) ----------
[
	Point.ByCoordinates(30000, 0),
	Point.ByCoordinates(0, 30000),
	Point.ByCoordinates(-30000, 0),
	Point.ByCoordinates(0, -18000)
];
# ----------------------------------------
boolean_2 = BoolSelector(true)
byPoints = PolyCurve.ByPoints(points=code_block, connectLastToFirst=boolean_2)
setback = DoubleSlider(3000, range=0..20000 step 1000)
max_height = DoubleSlider(40000, range=0..500000 step 1000)
siteMassGenerator = Site.Creation.SiteMassGenerator(SiteOutline=byPoints, Setback=setback, HeightLimit=max_height)
siteClashTest = Site.Analysis.SiteClashTest(BuildingMass=buildingGenerator.Floors, SiteMass=siteMassGenerator.SiteMass)
watch_2 = Watch(siteClashTest.Percent)
watch_3 = Watch(siteClashTest.DoesIntersect)
code_block_2 = CodeBlock { "Mass"; }
createRevitMass = Revit.ElementCreation.CreateRevitMass(CategoryName=code_block_2)  # unwired: Mass
